# Grasshopper definition A3-Clip.gh (Grasshopper 1.0.7)

slot_width = Slider(2.835, range=2..3)
radius = Slider(5, range=1..5)
slot_depth = Slider(40, range=0..40)
circle = Circle(Plane=PlaneXY(0, 0, 0), Radius=radius)
negative = Negative(Value=radius)
division = Division(A=slot_width, B=-2)
multiplication = Multiplication(A=radius, B=2)
vector_xyz = VectorXYZ(XComponent=negative, YComponent=0, ZComponent=0)  # -> Vector, Length
vector_xyz_2 = VectorXYZ(XComponent=division, YComponent=0, ZComponent=0)  # -> Vector, Length
cardboard_slot = Rectangle(Plane=PlaneXY(0, 0, 0), XSize=slot_width, YSize=slot_depth, Radius=0)  # -> Rectangle, Length
clips = Rectangle(Plane=PlaneXY(0, 0, 0), XSize=multiplication, YSize=slot_depth, Radius=0)  # -> Rectangle, Length
move = Move(Geometry=cardboard_slot.Rectangle, Motion=vector_xyz_2.Vector)  # -> Geometry, Transform
move_2 = Move(Geometry=clips.Rectangle, Motion=vector_xyz.Vector)  # -> Geometry, Transform
